# Grasshopper definition DaylightFactorParametric.gh (Grasshopper 1.0.7)
# plug-ins: ProceduralCS

ladybug = Ladybug_Ladybug()  # -> Vviiiiiiiiiizzz; plug-in component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
honeybee = Honeybee_Honeybee()  # -> Vviiiiiiiiiizzz; plug-in component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

# ----
# INPUTS
number_slider = Slider(8, range=8..10)
number_slider_2 = Slider(3, range=3..5)
number_slider_3 = Slider(0.7, range=0.5..0.7)
dom = ConstructDomain(DomainStart=0, DomainEnd=number_slider_2)
dom_2 = ConstructDomain(DomainStart=0, DomainEnd=number_slider)

# ----
# LOGIN TO COMPUTE
panel = Panel("https://compute.procedural.build")
# 0)
password = Text()
login = ComputeLogin(Username="INSERT YOUR USERNAME HERE", Password=password, ComputeURL=panel, Retry=Button())

# ----
# SETUP CASE GEOMETRY
number_slider_4 = Slider(5, range=3..5, expression="x*5")
dom_3 = ConstructDomain(DomainStart=0, DomainEnd=number_slider_4)
box = DomainBox(Base=PlaneXY(0, 0, 0), X=dom_2, Y=dom_3, Z=dom)
mass2zone = Honeybee_Masses2Zones(zoneMasses=flatten(box), maxRoofAngle=30, createHBZones=Toggle(True))  # -> readMe, HBZones; plug-in component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
glzparamlist = Honeybee_GlazingParametersList(northGlzParam=0, westGlzParam=number_slider_3, southGlzParam=0, eastGlzParam=number_slider_3)  # -> glzParamList; plug-in component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
# 2)
glazingcreator = Honeybee_GlazingBasedOnRatio(
    HBObjects=mass2zone.HBZones,
    glzRatio=glzparamlist,
    sillHeight=Slider(0.9, range=0..1),
    RADMaterials="Exterior_Window",
    runIt=Toggle(True))  # -> readMe, HBObjWGLZ; plug-in component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

# ---- group: CLICK ME TO RUN!
toggle = BooleanToggle(False)

# ----
# GET OR CREATE
# PROJECT AND TASK
genname = GhPythonScript(x=number_slider, z=number_slider_2, ratio=number_slider_3)  # -> out, name
# ---------- genname: Python ----------
__author__ = "kongs"
__version__ = "2020.11.19"

import rhinoscriptsyntax as rs

name = "width" + str(int(x)) + "_height" + str(int(z)) + "_ratio" + str(ratio)
# ---------- end genname ----------
panel_2 = Panel(genname.name)
panel_3 = Panel("Parametric Daylight Factor")
button = Button()
# 1)
project_and_task = GetOrCreateProjectAndTask(Auth=login, ProjectName=panel_3, TaskName=panel_2, Create=toggle)

# ----
# GENERATE PROBE POINTS
decomposebytype = Honeybee_DecomposeBasedOnType(HBZone=glazingcreator.HBObjWGLZ)  # -> walls, interiorWalls, airWalls, windows, interiorWindows, skylights, roofs, ceilings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; plug-in component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
flip = Flip(Surface=decomposebytype.groundFloors)  # -> Surface, Result
# 2a)
gentestpts = Honeybee_GenerateTestPoints(testGeometry=flip.Surface, gridSize=Slider(0.5, range=0..1), distBaseSrf=Slider(0.8, range=0..1), moveTestMesh=True)  # -> readMe, simplify(testPoints), simplify(ptsVectors), simplify(facesArea), simplify(mesh); plug-in component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

# ----
# Display
swatch = ColourSwatch(SwatchColor=RGB(0, 0, 0))
# Get Started: If you haven't done already, sign up for a free user account at https://compute.procedural.build/ to get started!
# For this demo to work you need to download and install Ladybug/HoneyBee - Legacy! You can find the plugin here: https://www.food4rhino.com/app/ladybug-tools
# 
# 0) Add your username (email) and password.
# 
# 1) Update the project name, number and task name. To create the new project and task click the button.
# 
# 2) Update/Check the case setup. This is just a simple setup with HoneyBee, where we take the geometry, turn it into a HoneyBee zone and add windows a default constructions.
# 2a) We add the probe points that we want to have.
# 2b) We generate the HoneyBee recipe for a Daylight Factor calculation
# 2c) We write the HoneyBee case into the specified folder path
# 
# 3) Click the button to upload and start simulating the case.
# 
# 4) Wait for the simulation to finish. When the result files are downloaded you need to click refresh for the Daylight Folder lookup component to refresh.
# 
# 5) Visualise the results by making the colored mesh
# 
# If you are having any questions, issues or feedback, you are welcome to post them at https://discourse.procedural.build/
# We will be there to answer any queries!
swatch_2 = ColourSwatch(SwatchColor=RGB(0, 0, 0))
medges = MeshEdges(Mesh=gentestpts.mesh)  # -> NakedEdges, InteriorEdges, NonManifoldEdges
wires = BrepWireframe(Brep=glazingcreator.HBObjWGLZ, Density=-1)
preview = CustomPreview(Geometry=wires, Material=swatch)
preview_2 = CustomPreview(Geometry=[medges.NakedEdges, medges.InteriorEdges], Material=swatch_2)

# ----
# Open Compute in Browser
button_2 = Button()
# 1a)
launch_browser = PythonScript(input=project_and_task, open=button_2)  # -> out
# ---------- launch_browser: Python ----------
import webbrowser
import json

taskId = ""
projectId = ""
url = ""

if input:
    input_ = json.loads(input)
    task = input_.get("task")
    project = input_.get("project")
    url = input_.get("url")
    if task:
        taskId = task.get("uid")
    if project:
        projectId = project.get("uid")



if url and taskId:
    url = url + "/project/" + projectId + "/task/" + taskId
    print url
else:
    print "Please provide input from Task/Project component"
    print "GOT url:", url, "TaskId:", taskId
if open:
    webbrowser.open(url, new=2)
# ---------- end launch_browser ----------
panel_4 = Panel(launch_browser)

# ----
# MAKE HB RECIPE
number_slider_5 = Slider(1, range=0..2)
radparameters = Honeybee_RADParameters(quality=number_slider_5)  # -> readMe, radParameters; plug-in component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
# 2b)
daylighfactorsimulation = Honeybee_DaylightFactorSimulation(
    testPoints=gentestpts.testPoints,
    ptsVectors=gentestpts.ptsVectors,
    testMesh=gentestpts.mesh,
    uniformSky=False,
    radParameters=radparameters.radParameters)  # -> analysisRecipe; plug-in component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

# ----
# WRITE HONEYBEE CASE
panel_5 = Panel("C:\Procedural")
folder_name = GhPythonScript(BasePath=panel_5, ProjectName=panel_3, TaskName=panel_2)  # -> out, ProjectPath, TaskPath
# ---------- folder_name: Python ----------
__author__ = "kongsgaard"
__version__ = "2020.08.31"

import rhinoscriptsyntax as rs
import os

if not BasePath:
    BasePath = "C:\Procedural"

if not ProjectName:
    ProjectName = "Project"
else:
    project_name_ = ProjectName.replace(" ", "_")
    
if not TaskName:
    TaskName = "Task"
else:
    task_name_ = TaskName.replace(" ", "_")
    
ProjectPath = os.path.join(BasePath, project_name_)
TaskPath = os.path.join(BasePath, project_name_, task_name_)
# ---------- end folder_name ----------
# 2c)
rundaylightanalysis = Honeybee_RunDaylightSimulation(
    HBObjects=flatten(glazingcreator.HBObjWGLZ),
    analysisRecipe=daylighfactorsimulation,
    writeRad=toggle,
    numOfCPUs=Slider(4, range=0..20),
    workingDir=folder_name.ProjectPath,
    radFileName=panel_2,
    overwriteResults=True)  # -> readMe, analysisType, resultsUnit, results, testPts, resultFiles, radGeoFile, studyFolder, done; plug-in component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

# ----
# 3)
# RUN IN CLOUD
compute = Compute(Input=project_and_task, Folder=rundaylightanalysis.studyFolder, Compute=toggle)  # -> Info, Output

# ----
# DOWNLOAD
python = GhPythonScript(x=folder_name.ProjectPath, y=panel_2)  # -> out, a
# ---------- python: Python ----------
__author__ = "kongs"
__version__ = "2020.11.22"

import rhinoscriptsyntax as rs


a = x + "\\" + y + "\\DF"
# ---------- end python ----------
# 4)
download = Download(Input=project_and_task, DownloadPath="foam", LocalPath=python.a, Reload=Button())
lookupfolder_daylighting = Honeybee_LookupDaylightingFolder(studyFolder=download, refresh=Button())  # -> analysisType, resultsUnit, resultFiles, ptsFiles, hdrFiles, imageFiles, iesFiles, epwFile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; plug-in component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
readradresults = Honeybee_ReadRADResult(
    analysisType=lookupfolder_daylighting.analysisType,
    resultFiles=lookupfolder_daylighting.resultFiles,
    testPts=gentestpts.testPoints,
    writeToFile=False)  # -> readMe, unit, values; plug-in component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

# ----
# VISUALIZE
number_slider_6 = Slider(15, range=0..100)
colors = Data([RGB(75, 107, 169), RGB(173, 203, 249), RGB(254, 244, 84), RGB(234, 126, 0), RGB(234, 38, 0)])
# 5)
recolor_mesh = RecolorMesh(
    Mesh=lookupfolder_daylighting.analysisMesh,
    Result=readradresults.values,
    ListOfColors=colors,
    UpperBoundary=number_slider_6,
    Segments=10)  # -> ColoredMesh, Colors, Values
python_2 = GhPythonScript(mesh=recolor_mesh.ColoredMesh, scale=Slider(1.2, range=0.5..5))  # -> out, text_point, rectangle
# ---------- python_2: Python ----------
__author__ = "kongs"
__version__ = "2020.09.15"

import rhinoscriptsyntax as rs

scale = scale or 1
bb = rs.BoundingBox(mesh)

point = bb[5]
point.X = point.X * 1.05 * scale
plane = rs.MovePlane(rs.WorldXYPlane(), point)

width = (bb[5].X - bb[4].X) * 0.15 * scale
height = (bb[3].Y - bb[4].Y)

rectangle = rs.AddRectangle(plane, width, height)

point_ = bb[0]
point_.Y = point_.Y - (height * 0.1 * scale)
text_point = rs.MovePlane(rs.WorldXYPlane(), point_)
# ---------- end python_2 ----------
legend = Legend(Colour=recolor_mesh.Colors, Tags=recolor_mesh.Values, Rectangle=python_2.rectangle, LegendType=1)
tag = TextTag3D(Location=python_2.text_point, Text="Daylight Factor %", Size=1, Colour=RGB(0, 0, 0), Justification=1)
