# Grasshopper definition Lighthouse-DEMO.gh (Grasshopper 1.0.7)
# plug-ins: Compute

# ----
# Mesh Settings
number_slider = Slider(0, range=0..100)
custom_mesh_settings = SettingsCustom(
    StitchSeams=True,
    SimplePlanes=Toggle(True),
    Refine=True,
    MinCount=number_slider,
    MaxCount=400,
    AspectRatio=20,
    MaxDistance=0,
    MaxAngle=Slider(60, range=0..100),
    MinEdge=0,
    MaxEdge=0)

# ----
# GEOMETRY
pipeline = GeometryPipeline(
    GroupByLayer=False,
    GroupByType=False,
    IncludeHidden=True,
    IncludeLocked=True,
    LayerFilter="Context - Far::Ground",
    NameFilter="*",
    SublayerFiltering=True,
    TypeFilter=1073741848)
pipeline_2 = GeometryPipeline(
    GroupByLayer=False,
    GroupByType=False,
    IncludeHidden=True,
    IncludeLocked=True,
    LayerFilter="Context - Far::Buildings",
    NameFilter="*",
    SublayerFiltering=True,
    TypeFilter=1073741848)
pipeline_3 = GeometryPipeline(
    GroupByLayer=False,
    GroupByType=False,
    IncludeHidden=True,
    IncludeLocked=True,
    LayerFilter="Context - Near::Ground",
    NameFilter="*",
    SublayerFiltering=True,
    TypeFilter=1073741848)
pipeline_4 = GeometryPipeline(
    GroupByLayer=False,
    GroupByType=False,
    IncludeHidden=True,
    IncludeLocked=True,
    LayerFilter="Context - Near::Buildings",
    NameFilter="*",
    SublayerFiltering=True,
    TypeFilter=1073741848)
pipeline_5 = GeometryPipeline(
    GroupByLayer=False,
    GroupByType=False,
    IncludeHidden=True,
    IncludeLocked=True,
    LayerFilter="Site::Ground",
    NameFilter="*",
    SublayerFiltering=True,
    TypeFilter=1073741848)
pipeline_6 = GeometryPipeline(
    GroupByLayer=False,
    GroupByType=False,
    IncludeHidden=True,
    IncludeLocked=True,
    LayerFilter="Site::Buildings",
    NameFilter="*",
    SublayerFiltering=True,
    TypeFilter=1073741848)
mesh = MeshBrep(Brep=pipeline_6, Settings=custom_mesh_settings)
mesh_2 = MeshBrep(Brep=pipeline_5, Settings=custom_mesh_settings)
mesh_3 = MeshBrep(Brep=pipeline, Settings=custom_mesh_settings)
mesh_4 = MeshBrep(Brep=pipeline_3, Settings=custom_mesh_settings)
mesh_5 = MeshBrep(Brep=pipeline_2, Settings=custom_mesh_settings)
mesh_6 = MeshBrep(Brep=pipeline_4, Settings=custom_mesh_settings)

# ----
# LOGIN TO COMPUTE
panel = Panel("https://compute.procedural.build")
# 0)
password = Text()
login = ComputeLogin(Username="INSERT YOUR USERNAME HERE", Password=password, ComputeURL=panel, Retry=Button())

# ----
# GET OR CREATE
# PROJECT AND TASK
panel_2 = Panel("Version 1")
# 1)
project_and_task = GetOrCreateProjectAndTask(Auth=login, ProjectName="Lighthouse", ProjectNumber="20200825", TaskName=panel_2, Create=Button())

# ----
# CONFIGURE MESHING
panel_3 = Panel("context_near_ground")
setnames = SetNames(Objs=mesh_2, Names="site_ground")
setnames_2 = SetNames(Objs=mesh_4, Names=panel_3)
setnames_3 = SetNames(Objs=mesh_6, Names="context_near_buildings")
setnames_4 = SetNames(Objs=mesh, Names="site_buildings")
setnames_5 = SetNames(Objs=[mesh_3, mesh_5], Names="context_far")
mesh_level = CFDMeshLevel(Objs=setnames_4, MinLevel=Slider(4, range=0..10), MaxLevel=0)
mesh_level_2 = CFDMeshLevel(Objs=setnames_2, MinLevel=Slider(2, range=0..10), MaxLevel=0)
mesh_level_3 = CFDMeshLevel(Objs=setnames_3, MinLevel=Slider(3, range=0..10), MaxLevel=0)
mesh_level_4 = CFDMeshLevel(Objs=setnames_5, MinLevel=Slider(3, range=0..10), MaxLevel=0)
mesh_level_5 = CFDMeshLevel(Objs=setnames, MinLevel=Slider(3, range=0..10), MaxLevel=0)
refinement_region = RefinementRegion(Meshes=mesh_level, Location="inside", MinLevel=Slider(3, range=0..10), MaxLevel=1)
toggle = BooleanToggle(True)
domain = CFDDomain(
    Objs=flatten([refinement_region, mesh_level_5, mesh_level_3, mesh_level_2, mesh_level_4]),
    CellSize=Slider(16, range=0..24),
    Z0=toggle,
    CenterXY=toggle,
    Square=toggle,
    XyScale=Slider(1.5, range=0..10),
    XyOffset=Slider(0, range=0..100),
    ZScale=Slider(2, range=0..10))  # -> Output, BoundingBox, Mesh
mesh_7 = ComputeMesh(Input=project_and_task, Domain=domain.Output)

# ----
# SET BOUNDARY CONDITIONS
panel_4 = Panel("""MaxZ
MinZ
MinX
MaxX""")
cfdbc = CfdBC(Names="MaxY", Preset="fixedVelocity", Overrides="{'U': '{ value uniform (0 -5 0); }'}")
cfdbc_2 = CfdBC(Names="MinY", Preset="fixedPressure")
cfdbc_3 = CfdBC(Names=panel_4, Preset="wall", Overrides="wallSlip")
merge = Merge(Data1=cfdbc, Data2=cfdbc_2, Data3=cfdbc_3)

# ----
# SETUP SOLVER
number_slider_2 = Slider(16, range=0..100)
list = ValueList({"potentialFoam", "simpleFoam"}, selected="simpleFoam")
panel_5 = Panel("""{
"init": 1000
}""")
# 2)
panel_6 = Panel("""6
4
1""")
cfd_solution = ComputeSolution(
    Input=mesh_7,
    CPUs=panel_6,
    Solver=list,
    CaseType="VirtualWindTunnel",
    BoundaryConditions=merge,
    Iterations=panel_5,
    NumberOfAngles=number_slider_2)

# ----
# CREATE A CUT PLANE
pipeline_7 = GeometryPipeline(
    GroupByLayer=False,
    GroupByType=False,
    IncludeHidden=True,
    IncludeLocked=True,
    LayerFilter="Site::Analysis Surface",
    NameFilter="*",
    SublayerFiltering=True,
    TypeFilter=1073741848)
python = GhPythonScript(testGeometry=pipeline_7, gridSize=Slider(1, range=0..3), distBaseSrf=Slider(1.2, range=0..3))  # -> readMe, simplify(testPoints), ptsVectors, facesArea, simplify(mesh); inputs testGeometry: GeometryBase
# ---------- python: Python ----------
### THIS COMPONENT IS COPIED FROM LADYBUG TOOLS. 
### IT IS COPIED TO MAKE DISTRIBUTION OF THIS GRASSHOPPER SCRIPT EASIER, BY HAVING LESS DEPENDENCIES.
### PLEASE REPLACE WITH THE ORIGINAL COMPONENT IF YOU HAVE LADYBUG INSTALLED

"""
Use this component to genrate a mesh with corresponding test points.  The resulting mesh will be in a format that the Recolor Mesh component will accept.
-
Provided by Honeybee 0.0.59
    Args:
        _testSurface: Test surface as a Brep.
        _gridSize: Size of the test grid.
        _distBaseSrf: Distance from base surface.
        moveTestMesh_: Set to 'False' if you want test mesh not to move. Default is 'True'.
    Returns:
        readMe!: ...
        testPoints: Test points
        ptsVectors: Vectors
        faceArea: Area of each mesh face
        mesh: Analysis mesh
"""

import Rhino as rc
import Grasshopper.Kernel as gh
from itertools import chain
import System.Threading.Tasks as tasks

def createMesh(brep, gridSize):
    ## mesh breps
    def makeMeshFromSrf(i, inputBrep):
        try:
            mesh[i] = rc.Geometry.Mesh.CreateFromBrep(inputBrep, meshParam)[0]
            inputBrep.Dispose()
        except:
            print 'Error in converting Brep to Mesh...'
            pass

    # prepare bulk list for each surface
    mesh = [None] * len(brep)

    # set-up mesh parameters for each surface based on surface size
    meshParam = rc.Geometry.MeshingParameters.Default
    meshParam.MaximumEdgeLength = gridSize
    meshParam.MinimumEdgeLength = gridSize
    meshParam.GridAspectRatio = 1

    for i in range(len(mesh)): makeMeshFromSrf(i, brep[i])
    
    return mesh

def flattenList(l):return list(chain.from_iterable(l))

def getTestPts(inputMesh, movingDis, moveTestMesh= False, parallel = True):
        
        # preparing bulk lists
        testPoint = [[]] * len(inputMesh)
        srfNormals = [[]] * len(inputMesh)
        meshSrfCen = [[]] * len(inputMesh)
        meshSrfArea = [[]] * len(inputMesh)
        
        srfCount = 0
        for srf in inputMesh:
            testPoint[srfCount] = range(srf.Faces.Count)
            srfNormals[srfCount] = range(srf.Faces.Count)
            meshSrfCen[srfCount] = range(srf.Faces.Count)
            meshSrfArea[srfCount] = range(srf.Faces.Count)
            srfCount += 1

        try:
            def srfPtCalculator(i):
                # calculate face normals
                inputMesh[i].FaceNormals.ComputeFaceNormals()
                inputMesh[i].FaceNormals.UnitizeFaceNormals()
                
                for face in range(inputMesh[i].Faces.Count):
                    srfNormals[i][face] = (inputMesh[i].FaceNormals)[face] # store face normals
                    meshSrfCen[i][face] = inputMesh[i].Faces.GetFaceCenter(face) # store face centers
                    # calculate test points
                    if srfNormals[i][face]:
                        movingVec = rc.Geometry.Vector3f.Multiply(movingDis,srfNormals[i][face])
                        testPoint[i][face] = rc.Geometry.Point3d.Add(rc.Geometry.Point3d(meshSrfCen[i][face]), movingVec)
                    # make mesh surface, calculate the area, dispose the mesh and mass area calculation
                    tempMesh = rc.Geometry.Mesh()
                    tempMesh.Vertices.Add(inputMesh[i].Vertices[inputMesh[i].Faces[face].A]) #0
                    tempMesh.Vertices.Add(inputMesh[i].Vertices[inputMesh[i].Faces[face].B]) #1
                    tempMesh.Vertices.Add(inputMesh[i].Vertices[inputMesh[i].Faces[face].C]) #2
                    tempMesh.Vertices.Add(inputMesh[i].Vertices[inputMesh[i].Faces[face].D]) #3
                    tempMesh.Faces.AddFace(0, 1, 3, 2)
                    massData = rc.Geometry.AreaMassProperties.Compute(tempMesh)
                    meshSrfArea[i][face] = massData.Area
                    massData.Dispose()
                    tempMesh.Dispose()
                    
                    
        except:
            print 'Error in Extracting Test Points'
            pass
        
        # calling the function
        if parallel:
            tasks.Parallel.ForEach(range(len(inputMesh)),srfPtCalculator)
        else:
            for i in range(len(inputMesh)):
                srfPtCalculator(i)
        
        if moveTestMesh:
            # find surfaces based on first normal in srfNormals - It is a simplification we can write a better function for this later
            for meshCount, mesh in enumerate(inputMesh):
                vector = srfNormals[meshCount][0]
                vector.Unitize()
                vector = rc.Geometry.Vector3d.Multiply(movingDis, vector)
                mesh.Translate(vector.X, vector.Y, vector.Z)
                
        return flattenList(testPoint), flattenList(srfNormals), flattenList(meshSrfArea), inputMesh


if _testGeometry!=None:
    inputMesh = []
    
    if type(_testGeometry) == rc.Geometry.Mesh and _distBaseSrf!=None:
        ghenv.Component.Params.Input[1].Name = '.'
        ghenv.Component.Params.Input[1].NickName = '.'
        inputMesh.append(_testGeometry)
        
    elif _gridSize!=None and _distBaseSrf!=None:
        initMesh = createMesh([_testGeometry], _gridSize)
        for m in initMesh: inputMesh.append(m)   

    if _distBaseSrf<0:
        msg = "Distance from base should be greater than 0. Flip the input surface instead of using a negative number."
        ghenv.Component.AddRuntimeMessage(gh.GH_RuntimeMessageLevel.Warning, msg)
    else:
        testPoints, ptsVectors, facesArea, mesh = getTestPts(inputMesh, _distBaseSrf, moveTestMesh_)
# ---------- end python ----------

# ----
# Display
# Get Started: If you haven't done already, sign up for a free user account at https://compute.procedural.build/ to get started!
# 
# 0) Add your username (email) and password.
# 
# 1) Update the project name, number and task name. To create the new project and task click the button.
# 
# 2) Update the solver configuration or leave the defaults.
# 
# 3) Click the button to upload and start simulating the case.
# 
# 4) Click the button to add the probe points. Make sure to create the C:/Procedural/ComputeVWTDemo folder to store the results in.
# 
# 5) Wait for the simulation to finish and visualise the results. Connect the Utrans values to the wire to see the results when they are done.
# 
# 6) Run the Wind Threshold component to compute the Lawson criteria.
# 
# If you are having any questions, issues or feedback, you are welcome to post them at https://discourse.procedural.build/
# We will be there to answer any queries!
swatch = ColourSwatch(SwatchColor=RGB(0, 0, 0))
medges = MeshEdges(Mesh=python.mesh)  # -> NakedEdges, InteriorEdges, NonManifoldEdges
wires = BrepWireframe(Brep=domain.BoundingBox, Density=-1)
preview = CustomPreview(Geometry=wires, Material=ColourSwatch(SwatchColor=RGB(0, 0, 0)))
preview_2 = CustomPreview(Geometry=domain.Mesh, Material=ColourSwatch(SwatchColor=RGB(153, 153, 153)))
preview_3 = CustomPreview(Geometry=[medges.NakedEdges, medges.InteriorEdges], Material=swatch)

# ----
# RUN ON COMPUTE
button = Button()
# 3)
compute = Compute(Input=cfd_solution, Mesh=domain.Mesh, Compute=button)

# ----
# Open Compute in Browser
button_2 = Button()
# 3a)
launch_browser = PythonScript(url=panel, input=project_and_task, open=button_2)  # -> out
# ---------- launch_browser: Python ----------
import webbrowser
import json

taskId = ""
projectId = ""

if input:
    input_ = json.loads(input)
    task = input_.get("task")
    project = input_.get("project")
    if task:
        taskId = task.get("uid")
    if project:
        projectId = project.get("uid")



if url and taskId:
    url = url + "/project/" + projectId + "/task/" + taskId
    print url
else:
    print "Please provide server url and taskId"
    print "GOT url:", url, "TaskId:", taskId
if open:
    webbrowser.open(url, new=2)
# ---------- end launch_browser ----------
panel_7 = Panel(launch_browser)

# ----
# PROBE AND DOWNLOAD
panel_8 = Panel("""lowerYard
surroundings
upperYard""")
panel_9 = Panel("""p
Utrans""")
# 4)
probe_points = ProbePoints(Input=compute, Points=python.testPoints, Names=panel_8, Fields=panel_9, Create=Button())
folder_name = GhPythonScript(BasePath="C:\Procedural", ProjectName="Lighthouse", TaskName=panel_2)  # -> out, ProjectPath, TaskPath
# ---------- folder_name: Python ----------
__author__ = "kongsgaard"
__version__ = "2020.08.31"

import rhinoscriptsyntax as rs
import os

if not BasePath:
    BasePath = "C:\Procedural"

if not ProjectName:
    ProjectName = "Project"
else:
    project_name_ = ProjectName.replace(" ", "_")
    
if not TaskName:
    TaskName = "Task"
else:
    task_name_ = TaskName.replace(" ", "_")
    
ProjectPath = os.path.join(BasePath, project_name_)
TaskPath = os.path.join(BasePath, project_name_, task_name_)
# ---------- end folder_name ----------
download = Download(Input=compute, DownloadPath="VWT/postProcessing/internalCloud", LocalPath=folder_name.TaskPath, Reload=Button())

# ----
# 6)
# RUN WIND THRESHOLD CALCULATION
panel_10 = Panel("\DNK_Copenhagen.061800_IWEC.epw")
download_epw = DownloadEPW(OpenBrowser=Button())
concat = Concatenate(FragmentA=folder_name.ProjectPath, FragmentB=panel_10)
panel_11 = Panel("""2
1
1""")
wind_thresholds = WindThresholds(Input=compute, EPWFiles=concat, PatchNames=panel_8, CPUs=panel_11, Create=Button())
download_2 = Download(Input=wind_thresholds, DownloadPath="urbanComfort", LocalPath=folder_name.TaskPath, Reload=Button())

# ----
# VISUALIZE LAWSON CRITERIA
number_slider_3 = Slider(1, range=0..1)
wind_threshold_results = WindThresholdResults(Folder=download_2, ThresholdType=number_slider_3)  # -> Info, Winter_morning, Winter_noon, Winter_afternoon, Winter_evenings, Spring_morning, Spring_noon, Spring_afternoon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
panel_12 = Panel(wind_threshold_results.Info)
# https://compute.procedural.build
bnd = Bounds(Numbers=flatten(wind_threshold_results.Yearly))
dedomain = DeconstructDomain(Domain=bnd)  # -> Start, End
panel_13 = Panel("""75,107,169
234,38,0""")
recolormesh = RecolorMesh(
    Mesh=python.mesh,
    Result=wind_threshold_results.Yearly,
    ListOfColors=panel_13,
    LowerBoundary=dedomain.Start,
    UpperBoundary=dedomain.End)  # -> Recolored, Colors, Values; disabled
legend_prepare = LegendPrepare_2(D=recolormesh.Colors, D_2=recolormesh.Values, C=python.mesh)  # -> _0_0_0, R, rectangle_2, pt_2
panel_14 = Panel("""Lawson Criteria
Yearly""")
legend = Legend(Colour=legend_prepare._0_0_0, Tags=legend_prepare.R, Rectangle=legend_prepare.rectangle_2, LegendType=1)
tag = TextTag3D(
    Location=legend_prepare.pt_2,
    Text=panel_14,
    Size=Slider(4, range=0..16),
    Colour=ColourSwatch(SwatchColor=RGB(0, 0, 0)),
    Justification=1)

# ----
# Visualize Vectors
number_slider_4 = Slider(2, range=0..15)
branch_mask = GhPythonScript(Index=number_slider_4)  # -> out, Path
# ---------- branch_mask: Python ----------
__author__ = "kongs"
__version__ = "2020.08.31"

import rhinoscriptsyntax as rs

if not Index:
    Index = 0
    
Path = "{*;" + str(Index) + "}"
# ---------- end branch_mask ----------

# ----
# VISUALIZE WIND ANGLES
# Visualize Values
# 5)
probe_results = ProbeResults(Folder=download)  # -> Info, Points, P, Utrans
panel_15 = Panel(probe_results.Info)
split = SplitTree(Data=probe_results.Utrans, Masks=flatten(branch_mask.Path))  # -> Positive, Negative
vlen = VectorLength(Vector=split.Positive)
panel_16 = Panel("""0,128,0
255,255,0
255,0,0""")

bnd_2 = Bounds(Numbers=flatten(vlen))
dedomain_2 = DeconstructDomain(Domain=bnd_2)  # -> Start, End
gradient = Gradient(
    LowerLimit=dedomain_2.Start,
    UpperLimit=dedomain_2.End,
    Parameter=split.Positive,
    stops=[0: RGB(0, 128, 0), 0.5: RGB(255, 255, 0), 1: RGB(255, 0, 0)])
vdisex = VectorDisplayEx(Point=flatten(probe_results.Points), Vector=flatten(split.Positive), Colour=flatten(gradient), Width=2)  # disabled

recolormesh_2 = RecolorMesh(Mesh=python.mesh, Result=vlen, ListOfColors=panel_16, LowerBoundary=dedomain_2.Start, UpperBoundary=dedomain_2.End)  # -> Recolored, Colors, Values; disabled
legend_prepare_2 = LegendPrepare(D=recolormesh_2.Colors, D_2=recolormesh_2.Values, C=python.mesh)  # -> _0_0, R, rectangle_2, pt_2

bang = ExplodeTree(Data=probe_results.Info)  # -> Branch0, Branch1
item = ListItem(List=bang.Branch1, Index=number_slider_4, Wrap=True)
number_slider_5 = Slider(4, range=0..16)
wind_direction = WindDirection(G=legend_prepare_2.pt_2, A=item)
swatch_2 = ColourSwatch(SwatchColor=RGB(0, 0, 0))
text = GhPythonScript(x="Wind Vectors", y=item)  # -> out, a
# ---------- text: Python ----------
__author__ = "kongs"
__version__ = "2020.09.04"

import rhinoscriptsyntax as rs


a = x + "\nWind Direction " + y
# ---------- end text ----------
legend_2 = Legend(Colour=legend_prepare_2._0_0, Tags=legend_prepare_2.R, Rectangle=legend_prepare_2.rectangle_2, LegendType=1)
text_2 = GhPythonScript(x="Wind Speeds (m/s)", y=item)  # -> out, a; same code as text
tag_2 = TextTag3D(Location=legend_prepare_2.pt_2, Text=text.a, Size=number_slider_5, Colour=swatch_2, Justification=1)
preview_4 = CustomPreview(Geometry=wind_direction, Material=swatch_2)
tag_3 = TextTag3D(Location=legend_prepare_2.pt_2, Text=text_2.a, Size=number_slider_5, Colour=swatch_2, Justification=1)

# ==== cluster LegendPrepare
C = ClusterInput()
D = ClusterInput()
D_2 = ClusterInput()
bbox = BoundingBox(Content=flatten(C), Plane=PlaneXY(0, 0, 0), UnionBox=True)  # -> Box, Box_2
bang = ExplodeTree(Data=D)  # -> Branch0, Branch1, Branch2
bang_2 = ExplodeTree(Data=D_2)  # -> Branch0, Branch1, Branch2
debox = DeconstructBox(Box=bbox.Box)  # -> Plane, X, Y, Z
_0_0 = ClusterOutput(bang.Branch0)
expression = Expression(x=bang_2.Branch0, Expression="Round(x, 2)")
dedomain = DeconstructDomain(Domain=debox.X)  # -> Start, End
dedomain_2 = DeconstructDomain(Domain=debox.Y)  # -> Start, End
neg = Negative(Value=dedomain_2.Start)
R = ClusterOutput(expression)
neg_2 = Negative(Value=dedomain.Start)
addition = Addition(A=neg, B=dedomain_2.End)
pt = ConstructPoint(XCoordinate=dedomain.Start, YCoordinate=dedomain_2.Start, ZCoordinate=0)
addition_2 = Addition(A=neg_2, B=dedomain.End)
multiplication = Multiplication(A=addition_2, B=Slider(0.03, range=0.01..0.2))
multiplication_2 = Multiplication(A=addition, B=0.7)
multiplication_3 = Multiplication(A=addition_2, B=0.05)
pt_2 = ClusterOutput(pt)
addition_3 = Addition(A=dedomain.End, B=multiplication)
pt_3 = ConstructPoint(XCoordinate=addition_3, YCoordinate=dedomain_2.Start, ZCoordinate=0)
dom = ConstructDomain(DomainStart=0, DomainEnd=multiplication_3)
dom_2 = ConstructDomain(DomainStart=0, DomainEnd=multiplication_2)
rectangle = Rectangle(Plane=pt_3, XSize=dom, YSize=dom_2, Radius=0)  # -> Rectangle, Length
rectangle_2 = ClusterOutput(rectangle.Rectangle)

# ==== cluster LegendPrepare_2
C = ClusterInput()
D = ClusterInput()
D_2 = ClusterInput()
bbox = BoundingBox(Content=flatten(C), Plane=PlaneXY(0, 0, 0), UnionBox=True)  # -> Box, Box_2
bang = ExplodeTree(Data=D)  # -> Branch0, Branch1, Branch2
bang_2 = ExplodeTree(Data=D_2)  # -> Branch0, Branch1, Branch2
debox = DeconstructBox(Box=bbox.Box)  # -> Plane, X, Y, Z
_0_0_0 = ClusterOutput(bang.Branch0)
expression = Expression(x=bang_2.Branch0, Expression="Round(x, 2)")
dedomain = DeconstructDomain(Domain=debox.X)  # -> Start, End
dedomain_2 = DeconstructDomain(Domain=debox.Y)  # -> Start, End
neg = Negative(Value=dedomain_2.Start)
R = ClusterOutput(expression)
neg_2 = Negative(Value=dedomain.Start)
addition = Addition(A=neg, B=dedomain_2.End)
pt = ConstructPoint(XCoordinate=dedomain.Start, YCoordinate=dedomain_2.Start, ZCoordinate=0)
addition_2 = Addition(A=neg_2, B=dedomain.End)
multiplication = Multiplication(A=addition_2, B=Slider(0.03, range=0.01..0.2))
multiplication_2 = Multiplication(A=addition, B=0.7)
multiplication_3 = Multiplication(A=addition_2, B=0.05)
pt_2 = ClusterOutput(pt)
addition_3 = Addition(A=dedomain.End, B=multiplication)
pt_3 = ConstructPoint(XCoordinate=addition_3, YCoordinate=dedomain_2.Start, ZCoordinate=0)
dom = ConstructDomain(DomainStart=0, DomainEnd=multiplication_3)
dom_2 = ConstructDomain(DomainStart=0, DomainEnd=multiplication_2)
rectangle = Rectangle(Plane=pt_3, XSize=dom, YSize=dom_2, Radius=0)  # -> Rectangle, Length
rectangle_2 = ClusterOutput(rectangle.Rectangle)

# ==== cluster WindDirection
number_slider = Slider(5, range=0..10)
vec = VectorXYZ(XComponent=number_slider, YComponent=number_slider, ZComponent=0)  # -> Vector, Length
Y = UnitY(Factor=1)
A = ClusterInput()
number_slider_2 = Slider(11, range=0..20)
G = ClusterInput()
rotate = Rotate(Geometry=Y, Angle=degrees(A), Plane=PlaneXY(0, 0, 0))  # -> Geometry, Transform
move = Move(Geometry=G, Motion=vec.Vector)  # -> Geometry, Transform
multiplication = Multiplication(A=number_slider_2, B=0.4)
line = LineSDL(Start=move.Geometry, Direction=rotate.Geometry, Length=number_slider_2)
rotate_2 = Rotate(Geometry=rotate.Geometry, Angle=degrees(Slider(200, range=0..360)), Plane=PlaneXY(0, 0, 0))  # -> Geometry, Transform
end = EndPoints(Curve=line)  # -> Start, End
line_2 = LineSDL(Start=end.End, Direction=rotate_2.Geometry, Length=multiplication)
L = ClusterOutput([line_2, line])
