# Grasshopper definition ComputeVWT-DEMO.gh (Grasshopper 1.0.7)
# plug-ins: ProceduralCS

# ----
# LOGIN TO COMPUTE
# This demo is matching version 2021.3.0 of the ComputeGH plugin
panel = Panel("https://compute.procedural.build")
# 0)
password = Text()
login = ComputeLogin(Username="INSERT YOUR USERNAME HERE", Password=password, ComputeURL=panel, Retry=Button())

# ----
# GEOMETRY
panel_2 = Panel("buildings")
mesh = Mesh([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])
set_names = SetNames(Meshes=mesh, Names=panel_2)
mesh_level = CFDMeshLevel(Meshes=set_names, MinLevel=Slider(2, range=0..10), MaxLevel=0)

# ----
# GET OR CREATE
# PROJECT AND TASK
panel_3 = Panel("Version 1")
# 1)
project_and_task = GetOrCreateProjectAndTask(Auth=login, ProjectName="Simple VWT", TaskName=panel_3, Create=Button())

# ----
# CONFIGURE MESHING
number_slider = Slider(0, range=0..100)
toggle = BooleanToggle(True)
list = ValueList({"3D": 0, "2D": 1}, selected="3D")
domain = CFDDomain(
    Objects=mesh_level,
    DomainType=list,
    CellSize=Slider(2, range=0..2),
    Z0=toggle,
    CenterXY=toggle,
    Square=toggle,
    XYScale=Slider(1.5, range=0..10),
    XYOffset=number_slider,
    ZScale=Slider(2, range=0..10))  # -> Output, Info, BoundingBox, Mesh
panel_4 = Panel(domain.Info)
mesh_2 = ComputeMesh(Input=project_and_task, Domain=domain.Output)

# ----
# Display
mesh_3 = Mesh(domain.Mesh)
# Get Started: If you haven't done already, sign up for a free user account at https://compute.procedural.build/ to get started!
# 
# 0) Add your username (email) and password.
# 
# 1) Update the project name, number and task name. To create the new project and task click the button.
# 
# 2) Update the solver configuration or leave the defaults.
# 
# 3) Click the button to upload and start simulating the case.
# 
# 4) Click the button to add the probe points. Make sure to create the C:/Procedural/ComputeVWTDemo folder to store the results in.
# 
# 5) Wait for the simulation to finish and visualise the results.
# 
# 6) Check the simulation progress in the browser.
# 
# If you are having any questions, issues or feedback, you are welcome to post them at https://discourse.procedural.build/
# We will be there to answer any queries!
swatch = ColourSwatch(SwatchColor=RGB(0, 0, 0))
medges = MeshEdges(Mesh=mesh_3)  # -> NakedEdges, InteriorEdges, NonManifoldEdges
wires = BrepWireframe(Brep=domain.BoundingBox, Density=-1)
preview = CustomPreview(Geometry=wires, Material=ColourSwatch(SwatchColor=RGB(0, 0, 0)))
preview_2 = CustomPreview(Geometry=domain.Mesh, Material=ColourSwatch(SwatchColor=RGB(153, 153, 153)))
preview_3 = CustomPreview(Geometry=[medges.NakedEdges, medges.InteriorEdges], Material=swatch)
facen = FaceNormals(Mesh=mesh_3)  # -> flatten(Centers), Normals
lng = ListLength(List=facen.Centers)
mesh_faces = Panel(lng)

# ----
# SET BOUNDARY CONDITIONS
panel_5 = Panel("{'U': '{ value uniform (0 -5 0); }'}")
panel_6 = Panel("""MaxZ
MinZ
MinX
MaxX""")
cfd_bc = CFDBoundaryCondition(Names="MaxY", Preset=2, Overrides=panel_5)
cfd_bc_2 = CFDBoundaryCondition(Names="MinY", Preset=3)
cfd_bc_3 = CFDBoundaryCondition(Names=panel_6, Preset=1)
merge = Merge(Data1=cfd_bc, Data2=cfd_bc_2, Data3=cfd_bc_3)

# ----
# Open Compute in Browser
toggle_2 = BooleanToggle(False)
# 1a)
launch_browser = PythonScript(input=project_and_task, open=toggle_2)  # -> out
# ---------- launch_browser: Python ----------
import webbrowser
import json

taskId = ""
projectId = ""
url = ""

if input:
    input_ = json.loads(input)
    task = input_.get("task")
    project = input_.get("project")
    url = input_.get("url")
    if task:
        taskId = task.get("uid")
    if project:
        projectId = project.get("uid")



if url and taskId:
    url = url + "/project/" + projectId + "/task/" + taskId
    print url
else:
    print "Please provide input from Task/Project component"
    print "GOT url:", url, "TaskId:", taskId
if open:
    webbrowser.open(url, new=2)
# ---------- end launch_browser ----------
panel_7 = Panel(launch_browser)

# ----
# SETUP SOLVER
list_2 = ValueList({"simpleFoam": 0, "potentialFoam": 1, "porousSimpleFoam": 2, "pisoFoam": 3, "buoyantSimpleFoam": 4, "buoyantPimpleFoam": 5, "buoyantBoussinesqSimpleFoam": 6, "buoyantBoussinesqPimpleFoam": 7}, selected="simpleFoam")
list_3 = ValueList({"SimpleCase": 0, "VirtualWindTunnel": 1, "MeshOnly": 2}, selected="VirtualWindTunnel")
# 2)
cfd_solution = ComputeSolution(
    Input=mesh_2,
    CPUs=Slider(4, range=1..24),
    Solver=list_2,
    CaseType=list_3,
    BoundaryConditions=merge,
    Iterations=Slider(300, range=0..1000),
    NumberOfAngles=Slider(4, range=0..100))

# ----
# CREATE A CUT PLANE
number_slider_2 = Slider(1.5, range=0..3)
bbox = BoundingBox(Content=mesh, Plane=PlaneXY(0, 0, 0))  # -> Box, Box_2
list_4 = ValueList({"X": 0, "Y": 1, "Z": 2}, selected="Z")
slicedomain = SliceDomain(
    Domain=domain.BoundingBox,
    Location=number_slider_2,
    GridSize=Slider(2, range=0..3),
    Exclude=bbox.Box,
    SliceDirection=list_4)  # -> AnalysisMesh, FaceCenters, FaceNormals

# ----
# RUN ON COMPUTE
button = Button()
# 3)
compute = Compute(Input=cfd_solution, Mesh=domain.Mesh, Compute=button)  # -> Info, Output
panel_8 = Panel(compute.Info)

# ----
# PROBE AND DOWNLOAD
button_2 = Button()
panel_9 = Panel("""Utrans
p""")
# 4)
probe_points = ProbePoints(Input=compute.Output, Points=slicedomain.FaceCenters, Fields=panel_9, CPUs=1, Create=button_2)
# https://compute.procedural.build
button_3 = Button()
concat = Concatenate(FragmentA="C:\Procedural\SimpleVWT\", FragmentB=panel_3)
download = Download(Input=probe_points, DownloadPath="VWT/postProcessing/internalCloud", LocalPath=concat, Reload=button_3)

load_probe_results = LoadProbeResults(Folder=download, Mesh=slicedomain.AnalysisMesh, Rerun=Button())  # -> Info, Points, Mesh
connect_to_utrans = Relay()
panel_10 = Panel(load_probe_results.Info)
vlen = VectorLength(Vector=connect_to_utrans)

# ----
# Visualize Vectors
bang = ExplodeTree(Data=connect_to_utrans)  # -> Branch0, Branch1, Branch2, Branch3
bnd = Bounds(Numbers=flatten(vlen))
dedomain = DeconstructDomain(Domain=bnd)  # -> Start, End
gradient = Gradient(
    LowerLimit=dedomain.Start,
    UpperLimit=dedomain.End,
    Parameter=bang.Branch0,
    stops=[0: RGB(0, 128, 0), 0.5: RGB(255, 255, 0), 1: RGB(255, 0, 0)])
vdisex = VectorDisplayEx(Point=load_probe_results.Points, Vector=bang.Branch0, Colour=gradient, Width=2)

# ----
# 5)
# Visualize Values
bang_2 = ExplodeTree(Data=vlen)  # -> Branch0, Branch1, Branch2, Branch3
panel_11 = Panel("""0,128,0
255,255,0
255,0,0""")
recolor_mesh = RecolorMesh(
    Mesh=load_probe_results.Mesh,
    Result=bang_2.Branch0,
    ListOfColors=panel_11,
    LowerBoundary=dedomain.Start,
    UpperBoundary=dedomain.End,
    Segments=10)  # -> ColoredMesh, Colors, Values
