# Grasshopper definition VWT_With_Vegetation.gh (Grasshopper 1.0.7)
# plug-ins: ProceduralCS

# ----
# LOGIN TO COMPUTE
# This demo is matching version 2021.3.6 of the ComputeGH plugin
panel = Panel("https://compute.procedural.build")
# 0)
password = Text()
login = ComputeLogin(Username="INSERT YOUR USERNAME HERE", Password=password, ComputeURL=panel, Retry=Button())

# ----
# GEOMETRY
buildings_mesh = Mesh([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])

vegetation = Mesh([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])
set_names = SetNames(Meshes=vegetation, Names="vegetation")
refinement_region = RefinementRegion(Meshes=set_names, Location="inside", MinLevel=Slider(2, range=0..10), MaxLevel=1)
get_names = GetNames(Meshes=refinement_region)
setset = CFDSetSet(Names=get_names, Location=[True, True, False], IsCellZone=Toggle(True))  # -> flatten(Output)

# ----
# GET OR CREATE
# PROJECT AND TASK
panel_2 = Panel("Version 1")
# 1)
project_and_task = GetOrCreateProjectAndTask(Auth=login, ProjectName="VWT with Vegetation", TaskName=panel_2, Create=Button())

# ----
# CONFIGURE MESHING
panel_3 = Panel("buildings")
set_names_2 = SetNames(Meshes=buildings_mesh, Names=panel_3)
mesh_level = CFDMeshLevel(Meshes=set_names_2, MinLevel=Slider(2, range=0..10), MaxLevel=0)
merge = Merge(Data1=mesh_level, Data2=refinement_region)
toggle = BooleanToggle(True)
list = ValueList({"3D": 0, "2D": 1}, selected="3D")
domain = CFDDomain(
    Objects=merge,
    DomainType=list,
    CellSize=Slider(2, range=0..2),
    Z0=toggle,
    CenterXY=toggle,
    Square=toggle,
    XYScale=Slider(1.5, range=0..10),
    XYOffset=Slider(0, range=0..100),
    ZScale=Slider(2, range=0..10))  # -> Output, Info, BoundingBox, Mesh
panel_4 = Panel(domain.Info)
mesh = ComputeMesh(Input=project_and_task, Domain=domain.Output, SetSet=setset)

# ----
# Display
mesh_2 = Mesh(domain.Mesh)
# Get Started: If you haven't done already, sign up for a free user account at https://compute.procedural.build/ to get started!
# 
# 0) Add your username (email) and password.
# 
# 1) Update the project name, number and task name. To create the new project and task click the button.
# 
# 2) Update the solver configuration or leave the defaults.
# 
# 3) Click the button to upload and start simulating the case.
# 
# 4) Click the button to add the probe points. Make sure to create the C:/Procedural/ComputeVWTDemo folder to store the results in.
# 
# 5) Wait for the simulation to finish and visualise the results.
# 
# 6) Check the simulation progress in the browser.
# 
# If you are having any questions, issues or feedback, you are welcome to post them at https://discourse.procedural.build/
# We will be there to answer any queries!
swatch = ColourSwatch(SwatchColor=RGBA(206, 230, 177, 171))
medges = MeshEdges(Mesh=mesh_2)  # -> NakedEdges, InteriorEdges, NonManifoldEdges
wires = BrepWireframe(Brep=domain.BoundingBox, Density=-1)
preview = CustomPreview(Geometry=wires, Material=ColourSwatch(SwatchColor=RGB(0, 0, 0)))
preview_2 = CustomPreview(Material=ColourSwatch(SwatchColor=RGB(224, 224, 224)))
preview_3 = CustomPreview(Geometry=[medges.NakedEdges, medges.InteriorEdges], Material=ColourSwatch(SwatchColor=RGB(0, 0, 0)))
preview_4 = CustomPreview(Geometry=refinement_region, Material=swatch)
facen = FaceNormals(Mesh=mesh_2)  # -> flatten(Centers), Normals
lng = ListLength(List=facen.Centers)
mesh_faces = Panel(lng)

# ----
# SET BOUNDARY CONDITIONS
panel_5 = Panel("{'U': '{ value uniform (0 -5 0); }'}")
panel_6 = Panel("""MaxZ
MinZ
MinX
MaxX""")
cfd_bc = CFDBoundaryCondition(Names="MaxY", Preset=2, Overrides=panel_5)
cfd_bc_2 = CFDBoundaryCondition(Names="MinY", Preset=3)
cfd_bc_3 = CFDBoundaryCondition(Names=panel_6, Preset=1)
merge_2 = Merge(Data1=cfd_bc, Data2=cfd_bc_2, Data3=cfd_bc_3)

# ----
# CONFIGURE POROSITY FOR VEGETATION
panel_7 = Panel("""{{NAME}} {
    type DarcyForchheimer;
    active yes;
    cellZone {{NAME}};

    d ({{darcyCoefficient}} {{darcyCoefficient}} {{darcyCoefficient}});
    f ({{porosityCoefficient}} {{porosityCoefficient}} {{porosityCoefficient}});
    coordinateSystem
    {
        type cartesian;
        origin (0 0 0);
        coordinateRotation
        {
            type axesRotation;
            e1 (1.0 0.0 0.0);
            e2 (0.0 0.0 1.0);
        }
    }
}""")
porocity = GhPythonScript(vegetationRegions=get_names, porosityCoefficient=Slider(0.3, range=0.05..0.5), template=panel_7)  # -> fvOptions; inputs vegetationRegions: list
# ---------- porocity: Python ----------
__author__ = "kongs"
__version__ = "2020.11.25"

import rhinoscriptsyntax as rs

begin = "constant>porosityProperties {\n//************************\n"
end = "\n//************************\n}"

fvOptions = begin
if not darcyCoefficient:
    darcyCoefficient = 0

for region in vegetationRegions:
    _template = template.replace("{{NAME}}", region)
    _template = _template.replace("{{darcyCoefficient}}", str(float(darcyCoefficient)))
    _template = _template.replace("{{porosityCoefficient}}", str(float(porosityCoefficient)))
    fvOptions += "\n" + _template + "\n"

fvOptions += end
# ---------- end porocity ----------
panel_8 = Panel(porocity)

# ----
# Open Compute in Browser
button = Button()
# 1a)
launch_browser = PythonScript(input=project_and_task, open=button)  # -> out
# ---------- launch_browser: Python ----------
import webbrowser
import json

taskId = ""
projectId = ""
url = ""

if input:
    input_ = json.loads(input)
    task = input_.get("task")
    project = input_.get("project")
    url = input_.get("url")
    if task:
        taskId = task.get("uid")
    if project:
        projectId = project.get("uid")



if url and taskId:
    url = url + "/project/" + projectId + "/task/" + taskId
    print url
else:
    print "Please provide input from Task/Project component"
    print "GOT url:", url, "TaskId:", taskId
if open:
    webbrowser.open(url, new=2)
# ---------- end launch_browser ----------
panel_9 = Panel(launch_browser)

# ----
# SETUP SOLVER
list_2 = ValueList({"simpleFoam": 0, "potentialFoam": 1, "porousSimpleFoam": 2, "pisoFoam": 3, "buoyantSimpleFoam": 4, "buoyantPimpleFoam": 5, "buoyantBoussinesqSimpleFoam": 6, "buoyantBoussinesqPimpleFoam": 7}, selected="porousSimpleFoam")
overrides = GhPythonScript(caseFiles=flatten(porocity))  # -> flatten(overrides); inputs fields: list, presets: list, caseFiles: list
# ---------- overrides: Python ----------
__author__ = "markp"
__version__ = "2020.09.11"

import json

overrides = json.dumps({"setup": setup, "fields": fields, "presets": presets, "caseFiles": caseFiles})
# ---------- end overrides ----------
list_3 = ValueList({"SimpleCase": 0, "VirtualWindTunnel": 1, "MeshOnly": 2}, selected="VirtualWindTunnel")
# 2)
cfd_solution = ComputeSolution(
    Input=mesh,
    CPUs=Slider(2, range=1..24),
    Solver=list_2,
    CaseType=list_3,
    BoundaryConditions=merge_2,
    Iterations=Slider(300, range=0..1000),
    NumberOfAngles=Slider(4, range=0..100),
    Overrides=overrides)

# ----
# CREATE A CUT PLANE
number_slider = Slider(1, range=0..3)
bbox = BoundingBox(Content=buildings_mesh, Plane=PlaneXY(0, 0, 0))  # -> Box, Box_2
# https://compute.procedural.build
list_4 = ValueList({"X": 0, "Y": 1, "Z": 2}, selected="Z")
slicedomain = SliceDomain(
    Domain=domain.BoundingBox,
    Location=Slider(1.5, range=0..3),
    GridSize=number_slider,
    Exclude=bbox.Box,
    SliceDirection=list_4)  # -> AnalysisMesh, FaceCenters, FaceNormals

# ----
# RUN ON COMPUTE
button_2 = Button()
# 3)
compute = Compute(Input=cfd_solution, Mesh=domain.Mesh, Compute=button_2)  # -> Info, Output
panel_10 = Panel(compute.Info)

# ----
# PROBE AND DOWNLOAD
button_3 = Button()
panel_11 = Panel("""Utrans
p""")
# 4)
probe_points = ProbePoints(Input=compute.Output, Points=slicedomain.FaceCenters, Fields=panel_11, CPUs=1, Create=button_3)
concat = Concatenate(FragmentA="C:\Procedural\VWTVegetation\", FragmentB=panel_2)
download = Download(Input=probe_points, DownloadPath="VWT/postProcessing/internalCloud", LocalPath=concat, Reload=Button())

load_probe_results = LoadProbeResults(Folder=download, Mesh=slicedomain.AnalysisMesh, Rerun=Button())  # -> Info, Points, Mesh
branch_mask = GhPythonScript(Index=Slider(0, range=0..3))  # -> out, Path
# ---------- branch_mask: Python ----------
__author__ = "kongs"
__version__ = "2020.08.31"

import rhinoscriptsyntax as rs

if not Index:
    Index = 0
    
Path = "{*;" + str(Index) + "}"
# ---------- end branch_mask ----------
connect_to_utrans = Relay()
panel_12 = Panel(load_probe_results.Info)
split = SplitTree(Data=connect_to_utrans, Masks=flatten(branch_mask.Path))  # -> Positive, Negative

# ----
# Visualize Vectors
vlen = VectorLength(Vector=connect_to_utrans)
bnd = Bounds(Numbers=flatten(vlen))
dedomain = DeconstructDomain(Domain=bnd)  # -> Start, End
gradient = Gradient(LowerLimit=dedomain.Start, UpperLimit=dedomain.End, stops=[0: RGB(0, 128, 0), 0.5: RGB(255, 255, 0), 1: RGB(255, 0, 0)])
vdisex = VectorDisplayEx(Point=load_probe_results.Points, Colour=gradient, Width=2)

# ----
# 5)
# Visualize Values
vlen_2 = VectorLength(Vector=split.Positive)
panel_13 = Panel("""0,128,0
255,255,0
255,0,0""")
recolor_mesh = RecolorMesh(
    Mesh=load_probe_results.Mesh,
    Result=vlen_2,
    ListOfColors=panel_13,
    LowerBoundary=dedomain.Start,
    UpperBoundary=dedomain.End,
    Segments=10)  # -> ColoredMesh, Colors, Values

pt = ConstructPoint(XCoordinate=Slider(5, range=0..50), YCoordinate=0, ZCoordinate=0)
basepoint = GhPythonScript(mesh=recolor_mesh.ColoredMesh, override=pt)  # -> out, base_point; inputs override: Point3d
# ---------- basepoint: Python ----------
__author__ = "Christian Kongsgaard"
__version__ = "2020.09.15"

import rhinoscriptsyntax as rs

bb = rs.BoundingBox(mesh)

base_point = bb[1]
base_point.Y = base_point.Y
base_point.X += override.X
base_point.Y += override.Y
base_point.Z += override.Z
# ---------- end basepoint ----------
legend = Legend(
    BasePoint=basepoint.base_point,
    Colors=reverse(recolor_mesh.Colors),
    Values=reverse(recolor_mesh.Values),
    Scale=Slider(8, range=1..10),
    TextHeight=Slider(3, range=1..10))  # -> Legend, Text

pt_2 = ConstructPoint(XCoordinate=Slider(0, range=0..50), YCoordinate=0, ZCoordinate=0)
basepoint_2 = GhPythonScript(mesh=recolor_mesh.ColoredMesh, override=pt_2)  # -> out, base_point; inputs override: Point3d
# ---------- basepoint_2: Python ----------
__author__ = "Christian Kongsgaard"
__version__ = "2020.09.15"

import rhinoscriptsyntax as rs

bb = rs.BoundingBox(mesh)

base_point = bb[0]
base_point.Y = base_point.Y
base_point.X += override.X
base_point.Y += override.Y
base_point.Z += override.Z
# ---------- end basepoint_2 ----------
tag = TextTag3D(
    Location=basepoint_2.base_point,
    Text="Wind Velocity (m/s)",
    Size=Slider(3, range=0.5..5),
    Colour=RGB(0, 0, 0),
    Justification=1)
