# Grasshopper definition WindThresholds.gh (Grasshopper 1.0.7)
# plug-ins: ProceduralCS

swatch = ColourSwatch(SwatchColor=RGB(153, 153, 153))

# ----
# LOGIN TO COMPUTE
# This demo is matching version 2021.3.6 of the ComputeGH plugin
panel = Panel("https://compute.procedural.build")
# 0)
password = Text()
login = ComputeLogin(Username="INSERT YOUR USERNAME HERE", Password=password, ComputeURL=panel, Retry=Button())

# ----
# GEOMETRY
mesh = Mesh([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])

# ----
# GET OR CREATE
# PROJECT AND TASK
panel_2 = Panel("Version 1")
# 1)
project_and_task = GetOrCreateProjectAndTask(Auth=login, ProjectName="Wind Thresholds", TaskName=panel_2, Create=Button())
panel_3 = Panel(project_and_task)

# ----
# CONFIGURE MESHING
panel_4 = Panel("buildings")
set_names = SetNames(Meshes=mesh, Names=panel_4)
mesh_level = CFDMeshLevel(Meshes=set_names, MinLevel=Slider(2, range=0..10), MaxLevel=0)
toggle = BooleanToggle(True)
list = ValueList({"3D": 0, "2D": 1}, selected="3D")
domain = CFDDomain(
    Objects=mesh_level,
    DomainType=list,
    CellSize=Slider(2, range=0..2),
    Z0=toggle,
    CenterXY=toggle,
    Square=toggle,
    XYScale=Slider(1.5, range=0..10),
    XYOffset=Slider(0, range=0..100),
    ZScale=Slider(2, range=0..10))  # -> Output, Info, BoundingBox, Mesh
panel_5 = Panel(domain.Info)
mesh_2 = ComputeMesh(Input=project_and_task, Domain=domain.Output)

# ----
# Display
mesh_3 = Mesh(domain.Mesh)
# Get Started: If you haven't done already, sign up for a free user account at https://compute.procedural.build/ to get started!
# 
# 0) Add your username (email) and password.
# 
# 1) Update the project name, number and task name. To create the new project and task click the button.
# 
# 2) Update the solver configuration or leave the defaults.
# 
# 3) Click the button to upload and start simulating the case.
# 
# 4) Click the button to add the probe task.
# 
# 5) Select the wind comfort criteria you want use.
# 
# 6) Create the wind comfort task.
# 
# 7 ) Wait for the simulation to finish and visualise the results.
# 
# If you are having any questions, issues or feedback, you are welcome to post them at https://discourse.procedural.build/
# We will be there to answer any queries!
swatch_2 = ColourSwatch(SwatchColor=RGB(0, 0, 0))
medges = MeshEdges(Mesh=mesh_3)  # -> NakedEdges, InteriorEdges, NonManifoldEdges
wires = BrepWireframe(Brep=domain.BoundingBox, Density=-1)
preview = CustomPreview(Geometry=wires, Material=ColourSwatch(SwatchColor=RGB(0, 0, 0)))
preview_2 = CustomPreview(Geometry=domain.Mesh, Material=ColourSwatch(SwatchColor=RGB(222, 222, 222)))
preview_3 = CustomPreview(Geometry=[medges.NakedEdges, medges.InteriorEdges], Material=swatch_2)
facen = FaceNormals(Mesh=mesh_3)  # -> flatten(Centers), Normals
lng = ListLength(List=facen.Centers)
mesh_faces = Panel(lng)

# ----
# SET BOUNDARY CONDITIONS
panel_6 = Panel("{'U': '{ value uniform (0 -5 0); }'}")
panel_7 = Panel("""MaxZ
MinZ
MinX
MaxX""")
cfd_bc = CFDBoundaryCondition(Names="MaxY", Preset=2, Overrides=panel_6)
cfd_bc_2 = CFDBoundaryCondition(Names="MinY", Preset=3)
cfd_bc_3 = CFDBoundaryCondition(Names=panel_7, Preset=1)
merge = Merge(Data1=cfd_bc, Data2=cfd_bc_2, Data3=cfd_bc_3)

# ----
# Open Compute in Browser
toggle_2 = BooleanToggle(False)
# 1a)
launch_browser = PythonScript(input=project_and_task, open=toggle_2)  # -> out
# ---------- launch_browser: Python ----------
import webbrowser
import json

taskId = ""
projectId = ""
url = ""

if input:
    input_ = json.loads(input)
    task = input_.get("task")
    project = input_.get("project")
    url = input_.get("url")
    if task:
        taskId = task.get("uid")
    if project:
        projectId = project.get("uid")



if url and taskId:
    url = url + "/project/" + projectId + "/task/" + taskId
    print url
else:
    print "Please provide input from Task/Project component"
    print "GOT url:", url, "TaskId:", taskId
if open:
    webbrowser.open(url, new=2)
# ---------- end launch_browser ----------
panel_8 = Panel(launch_browser)

list_2 = ValueList({"SimpleCase": 0, "VirtualWindTunnel": 1, "MeshOnly": 2}, selected="VirtualWindTunnel")

# ----
# SETUP SOLVER
list_3 = ValueList({"simpleFoam": 0, "potentialFoam": 1, "porousSimpleFoam": 2, "pisoFoam": 3, "buoyantSimpleFoam": 4, "buoyantPimpleFoam": 5, "buoyantBoussinesqSimpleFoam": 6, "buoyantBoussinesqPimpleFoam": 7}, selected="simpleFoam")
# 2)
cfd_solution = ComputeSolution(
    Input=mesh_2,
    CPUs=Slider(2, range=1..24),
    Solver=list_3,
    CaseType=list_2,
    BoundaryConditions=merge,
    Iterations=Slider(300, range=0..1000),
    NumberOfAngles=Slider(4, range=0..100))

# ----
# CREATE A CUT PLANE
number_slider = Slider(1.5, range=0..3)
bbox = BoundingBox(Content=mesh, Plane=PlaneXY(0, 0, 0))  # -> Box, Box_2
list_4 = ValueList({"X": 0, "Y": 1, "Z": 2}, selected="Z")
slicedomain = SliceDomain(
    Domain=domain.BoundingBox,
    Location=number_slider,
    GridSize=Slider(2, range=0..3),
    Exclude=bbox.Box,
    SliceDirection=list_4)  # -> AnalysisMesh, FaceCenters, FaceNormals

# ----
# RUN ON COMPUTE
# 3)
button = Button()
compute = Compute(Input=cfd_solution, Mesh=domain.Mesh, Compute=button)  # -> Info, Output
panel_9 = Panel(compute.Info)

# ----
# PICK CRITERIA
# THRESHOLD VALUES (m/s)
# THRESHOLD FREQUENCIES (%)
panel_10 = Panel("""NEN 8100
Davenport
Lawson LDDC
Lawson 2001""")
number_slider_2 = Slider(3, range=0..3)
davenport = Panel("""{"field": "sitting long", "value": 3.6}
{"field": "sitting short", "value": 5.3}
{"field": "walking leisurely", "value": 7.6}
{"field": "walking fast", "value": 9.8}
{"field": "uncomfortable", "value": 9.8}
{"field": "dangerous", "value": 15.1}""")
nen_8100 = Panel("""{"field": "sitting long", "value": 5}
{"field": "sitting short", "value": 5}
{"field": "walking leisurely", "value": 5}
{"field": "walking fast", "value": 5}
{"field": "uncomfortable", "value": 5}""")
lawson_lddc = Panel("""{"field": "frequent sitting", "value": 2.5}
{"field": "occasional sitting", "value": 4}
{"field": "standing", "value": 6}
{"field": "walking", "value": 8}
{"field": "uncomfortable", "value": 8}
{"field": "unsafe", "value": 15}""")
lawson_2001 = Panel("""{"field": "sitting", "value": 4}
{"field": "standing", "value": 6}
{"field": "strolling", "value": 8}
{"field": "business walking", "value": 10}
{"field": "uncomfortable", "value": 10}
{"field": "unsafe frail", "value": 15}
{"field": "unsafe all", "value": 20}""")
# 5)
item = ListItem(List=panel_10, Index=number_slider_2, Wrap=True)
panel_11 = Panel(item)
entwine = Entwine(Branch00=nen_8100, Branch01=davenport, Branch02=lawson_lddc, Branch03=lawson_2001, FlattenInputs=True)  # -> simplify(Result)
branch = TreeBranch(Tree=entwine, Path=number_slider_2, MaintainPaths=True)
nen_8100_2 = Panel("""{"field": "sitting long", "value": 2.5}
{"field": "sitting short", "value": 5}
{"field": "walking leisurely", "value": 10}
{"field": "walking fast", "value": 20}
{"field": "uncomfortable", "value": 80}""")
davenport_2 = Panel("""{"field": "sitting long", "value": 1.5}
{"field": "sitting short", "value": 1.5}
{"field": "walking leisurely", "value": 1.5}
{"field": "walking fast", "value": 1.5}
{"field": "uncomfortable", "value": 98.5}
{"field": "dangerous", "value": 99.99}""")
lawson_lddc_2 = Panel("""{"field": "frequent sitting", "value": 5}
{"field": "occasional sitting", "value": 5}
{"field": "standing", "value": 5}
{"field": "walking", "value": 5}
{"field": "uncomfortable", "value": 95}
{"field": "unsafe", "value": 99.978}""")
lawson_2001_2 = Panel("""{"field": "sitting", "value": 5}
{"field": "standing", "value": 5}
{"field": "strolling", "value": 5}
{"field": "business walking", "value": 5}
{"field": "uncomfortable", "value": 95}
{"field": "unsafe frail", "value": 99.977}
{"field": "unsafe all", "value": 99.977}""")
entwine_2 = Entwine(Branch00=nen_8100_2, Branch01=davenport_2, Branch02=lawson_lddc_2, Branch03=lawson_2001_2, FlattenInputs=True)  # -> simplify(Result)
# https://compute.procedural.build
branch_2 = TreeBranch(Tree=entwine_2, Path=number_slider_2, MaintainPaths=True)

# ----
# PROBE
# 4)
button_2 = Button()
panel_12 = Panel("""Utrans
p""")
probe_points = ProbePoints(Input=compute.Output, Points=slicedomain.FaceCenters, Names="plane", Fields=panel_12, CPUs=1, Create=button_2)

# ----
# CREATE WIND THRESHOLDS
panel_13 = Panel("C:\Procedural\WindThresholds\DNK_Copenhagen.061800_IWEC.epw")
download_epw = DownloadEPW(OpenBrowser=Button())
# 6)
button_3 = Button()
wind_thresholds = WindThresholds(
    Input=probe_points,
    EPWFiles=panel_13,
    PatchNames="plane",
    Thresholds=branch,
    CPUs=Slider(1, range=1..10),
    Create=button_3)

# ----
# CALCULATE FREQUENCIES
panel_14 = Panel("C:\Procedural\WindThresholds\")
concat = Concatenate(FragmentA=panel_14, FragmentB=panel_11)
download = Download(Input=wind_thresholds, DownloadPath="urbanComfort", LocalPath=concat, Reload=Button())
button_4 = Button()
wind_threshold_results = WindThresholdResults(Folder=download, ThresholdType=Slider(1, range=0..1), ThresholdFrequency=branch_2)  # -> Info, Winter_morning, Winter_noon, Winter_afternoon, Winter_evenings, Spring_morning, Spring_noon, Spring_afternoon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
panel_15 = Panel(wind_threshold_results.Info)

# ----
# VISUALIZE
lng_2 = ListLength(List=branch_2)  # -> expr("x-1", Length)
colors = Data([RGB(5, 48, 97), RGB(33, 102, 172), RGB(67, 147, 195), RGB(146, 197, 222), RGB(209, 229, 240), RGB(255, 255, 255), RGB(253, 219, 199), RGB(244, 165, 130), RGB(214, 96, 77), RGB(178, 24, 43), RGB(103, 0, 31)])
branch_3 = TreeBranch(Tree=panel_15, Path="{1}", MaintainPaths=True)
recolor_mesh = RecolorMesh(
    Mesh=slicedomain.AnalysisMesh,
    Result=wind_threshold_results.Yearly,
    ListOfColors=colors,
    UpperBoundary=lng_2,
    Segments=lng_2)  # -> ColoredMesh, Colors, Values
# 7)
pt = ConstructPoint(XCoordinate=Slider(0, range=0..50), YCoordinate=0, ZCoordinate=0)
basepoint = GhPythonScript(mesh=recolor_mesh.ColoredMesh, override=pt)  # -> out, base_point; inputs override: Point3d
# ---------- basepoint: Python ----------
__author__ = "Christian Kongsgaard"
__version__ = "2020.09.15"

import rhinoscriptsyntax as rs

bb = rs.BoundingBox(mesh)

base_point = bb[0]
base_point.Y = base_point.Y
base_point.X += override.X
base_point.Y += override.Y
base_point.Z += override.Z
# ---------- end basepoint ----------
text = GhPythonScript(title="Wind Comfort Criteria", thresholds=panel_10, thresholdIndex=number_slider_2)  # -> out, a; inputs thresholds: list, thresholdIndex: Int32
# ---------- text: Python ----------
__author__ = "Christian Kongsgaard"
__version__ = "2020.09.04"

import json

comfort = thresholds[thresholdIndex]
a = title + "\n" + comfort
# ---------- end text ----------
tag = TextTag3D(Location=basepoint.base_point, Text=text.a, Size=Slider(3, range=0.5..5), Colour=RGB(0, 0, 0), Justification=1)

pt_2 = ConstructPoint(XCoordinate=Slider(5, range=0..50), YCoordinate=0, ZCoordinate=0)
basepoint_2 = GhPythonScript(mesh=recolor_mesh.ColoredMesh, override=pt_2)  # -> out, base_point; inputs override: Point3d
# ---------- basepoint_2: Python ----------
__author__ = "Christian Kongsgaard"
__version__ = "2020.09.15"

import rhinoscriptsyntax as rs

bb = rs.BoundingBox(mesh)

base_point = bb[1]
base_point.Y = base_point.Y
base_point.X += override.X
base_point.Y += override.Y
base_point.Z += override.Z
# ---------- end basepoint_2 ----------
legend = Legend(
    BasePoint=basepoint_2.base_point,
    Colors=reverse(recolor_mesh.Colors),
    Values=branch_3,
    Scale=Slider(8, range=1..10),
    TextHeight=Slider(3, range=1..10))  # -> Legend, Text
